# Requirement set NGOS (R2024b)
Need: Our vehicle is for abled body college students between 5'6” and 6’4” ft, with a max weight limit of 300 lbs.
The ideal geography is in mid-Atlantic urban areas, and it is used for commuting only 10 miles a day via this bike.
The vehicle will be used for small grocery runs, going to and from class, and going for brief leisure rides.
 It will withstand elements such as rain and snow and have a sporty aspect that is conducive to driving.
The vehicle will have sensing capabilities to relay the vehicle’s performance to the driver.

## 1 [Flexible anthropology of a person]

### 1.1 [Height Compensation]
5' - 6' 4"

#### 1.1.1 [Fit in seat]

##### 1.1.1.1 [Lower Lumbar Support]

#### 1.1.2 [Comfortable Handlebars]

#### 1.1.3 [Reaching pedals]

### 1.2 [Weight Compensation]
<300 lbs

#### 1.2.1 [Structure is Unable deform under 300 lbs load]

### 1.3 [Endurance / Strength Compensation]

#### 1.3.1 [Pedal Strength Compensation]
Force needed to do work on the pedals

#### 1.3.2 [Steering Compensation]

#### 1.3.3 [Aerodynamic Drag Mitigation]

## 2 [Built for Urban Destinations]

### 2.1 [Travel to class]

#### 2.1.1 [Be able to secure the vehicle when not in operation]

#### 2.1.2 [Sleek Design]
We dont want to look

#### 2.1.3 [Comfortably move around people]
Ability to comfortably move around people

### 2.2 [Sport Driving Condititions]
Speeds reach 20+mph

#### 2.2.1 [Must reach a velocity of 30mph forward]

#### 2.2.2 [Acceleration of min 5m/s^2]

### 2.3 [Small Grocery Runs]

#### 2.3.1 [Cargo Compartment]

#### 2.3.2 [Secured Cargo]
Being able to

### 2.4 [Leisure Riding Conditions]

#### 2.4.1 [Minimal Effort for Actuaction]

## 3 [Mid-Atlantic Weather/Geography Conditions]
The goal is to ride in the same conditions as a car.

### 3.1 [Rain]

### 3.2 [Snow]

### 3.3 [Heat]

### 3.4 [Mud]

### 3.5 [Hills]

## 4 [Enhanced Driver Situational Awareness]

### 4.1 [Sensors]

#### 4.1.1 [Wheel Rotation Speed]

#### 4.1.2 [Lane Position Localization]
Being able to stay in your own lane

#### 4.1.3 [Wattage]

#### 4.1.4 [Temperature]

#### 4.1.5 [Battery / Voltage level]

#### 4.1.6 [Accel/ decel]

#### 4.1.7 [Speed]

#### 4.1.8 [Sensor Operation Validation]
The Idea here is to indicate whether or not a sensor is working "in condition" or in other words, providing accurate measurements. (TLDR: Working or faulty)

### 4.2 [Ergonomic Indicators]
The ability to see the system diagnostics at a glance

## 5 [Safety]

### 5.1 [Rollover and Fall Protection]
RO: 90deg+ of falling tilt
Fall: Up to 90 deg of falling tilt

#### 5.1.1 [Driver immovability]
When is in a crash, we dont want them to move out of their seat or for their head to experience too much whiplash.

### 5.2 [Electrical Protection]

#### 5.2.1 [Emergency Shutoff Capabilities]

#### 5.2.2 [Component Preservation]
Some components may overheat or draw too much current. We need to mitigate that.

### 5.3 [Health Safety]

#### 5.3.1 [Preventing Cuts]

#### 5.3.2 [Cardiology Safety]
Want to be mindful of drives heart rate and making sure they dont over exhaust themselves

#### 5.3.3 [Legal Health Aspects]

##### 5.3.3.1 [Head Safety]

##### 5.3.3.2 [Leg Safety]

##### 5.3.3.3 [Arm Safety]

#### 5.3.4 [Driver Ingress and Egress]

### 5.4 [Road Safety]

#### 5.4.1 [Road Visibility]
To see and be seen