# Requirement set components (R2024b)

## 1 [Electronics and Sensing] (Container)

### 1.1 [Computing]

### 1.2 [Sensors]

#### 1.2.1 [IMU]
Initerial Measurement Unit

#### 1.2.2 [Encoders]

#### 1.2.3 [Lane Position Management System]

#### 1.2.4 [Voltmeter]

#### 1.2.5 [Ampmeter]

#### 1.2.6 [Thermo Couple]

### 1.3 [Electrical Connections] (Container)

#### 1.3.1 [Water Proof Wires]

#### 1.3.2 [Electrical Terminal Box]
Rationale: This component could also be a fuse box

#### 1.3.3 [Voltage Regulators]

#### 1.3.4 [Fuses]

#### 1.3.5 [DC Buck Converters]

### 1.4 [EPS]
Electrical Power System

#### 1.4.1 [Physical E-Stop / Breaker Switch]

#### 1.4.2 [Software Softstop]
Rationale: Potentially, the motor may overheat, and to mitigate that, we can have the software make sure the nominal temp is always good
Keywords: Software

### 1.5 [Human Interfaces] (Container)

#### 1.5.1 [Display Screen]
Rationale: To see all

#### 1.5.2 [Voltmeter]

### 1.6 [Displays]

### 1.7 [Motor Battery]

### 1.8 [Aux Battery]

## 2 [Vehicle Dynamics] (Container)

### 2.1 [Gear Cassettes]

### 2.2 [Breaks]

### 2.3 [Wheel Selection]

#### 2.3.1 [Tires]

#### 2.3.2 [Rims]

### 2.4 [Deraillurs]

### 2.5 [Pedals]

### 2.6 [Motor]

### 2.7 [Chain Link]
Chain link

## 3 [Frame and Structures] (Container)

### 3.1 [Chassis]

### 3.2 [RPS]
Roll over Protection System

### 3.3 [Seating]

### 3.4 [Steering]

### 3.5 [Tow Hitch]

### 3.6 [Harness]

### 3.7 [RWD Sys]

#### 3.7.1 [#50]

## 4 [Driver] (Container)

### 4.1 [Safety]

#### 4.1.1 [Heart Rate Monitor]

#### 4.1.2 [Helmet]

### 4.2 [Communications]

#### 4.2.1 [Telecommunications / Coms]