# Requirement set NGOS (R2024b)
Need: Our vehicle is for abled body college students between 5” and 6’4” ft, with a max weight limit of 300 lbs.
The ideal geography is in mid-Atlantic urban areas, and it is used for commuting only 10 miles a day via this bike.
The vehicle will be used for small grocery runs, going to and from class, and going for brief leisure rides.
 It will withstand elements such as rain and snow and have a sporty aspect that is conducive to driving.
The vehicle will have sensing capabilities to relay the vehicle’s performance to the driver.

## 1 [Safety] (Container)

### 1.1 [Rollover and Fall Protection]
RO: 90deg+ of falling tilt
Fall: Up to 90 deg of falling tilt

#### 1.1.1 [Driver immovability]
When in a crash, we dont want them to move out of their seat or for their head to experience too much whiplash.

### 1.2 [Electrical Protection] (Container)

#### 1.2.1 [Emergency Shutoff Capabilities]

#### 1.2.2 [Component Preservation]
Some components may overheat or draw too much current. We need to mitigate that.

### 1.3 [Health Safety] (Container)

#### 1.3.1 [Preventing Cuts]

#### 1.3.2 [Cardiology Safety]
Want to be mindful of drivers heart rate and making sure they dont over exhaust themselves

#### 1.3.3 [Legal Health Aspects] (Container)

##### 1.3.3.1 [Head Safety]

##### 1.3.3.2 [Leg Safety]

##### 1.3.3.3 [Arm Safety]

#### 1.3.4 [Driver Ingress and Egress]
How the Driver enters and exits the vehicle.
Must be:
-safe
-?

### 1.4 [Road Safety] (Container)

#### 1.4.1 [Road Visibility]
To see and be seen
ex.
Turn Signals
Mirrors

## 2 [Flexible anthropology of a person] (Container)

### 2.1 [Height Compensation] (Container)
5' - 6' 4"

#### 2.1.1 [Fit in seat]

##### 2.1.1.1 [Lower Lumbar Support]

#### 2.1.2 [Comfortable Handlebars]

#### 2.1.3 [Reaching pedals]

### 2.2 [Weight Compensation] (Container)
<300 lbs

#### 2.2.1 [Structure is unable to deform under 300 lbs load]

### 2.3 [Endurance / Strength Compensation] (Container)

#### 2.3.1 [Pedal Strength Compensation]
Force needed to do work on the pedals

#### 2.3.2 [Steering Compensation]

#### 2.3.3 [Aerodynamic Drag Mitigation]
ex. Motorcycle fairings

## 3 [Built for Urban Destinations] (Container)

### 3.1 [Travel to class] (Container)

#### 3.1.1 [Be able to secure the vehicle when not in operation]

#### 3.1.2 [Sleek Design]
We dont want to look odd

#### 3.1.3 [Comfortably move around people]
Ability to comfortably move around people

### 3.2 [Sport Driving Condititions]
Speeds reach 20+mph

#### 3.2.1 [Must reach a velocity of 30mph forward]

#### 3.2.2 [Acceleration Goals]

### 3.3 [Small Grocery Runs] (Container)

#### 3.3.1 [Cargo Compartment]

#### 3.3.2 [Secured Cargo]
Being able to

### 3.4 [Leisure Riding Conditions]

#### 3.4.1 [Minimal Effort for Actuaction]

## 4 [Mid-Atlantic Weather/Geography Conditions] (Container)
The goal is to ride in the same conditions as a car.

### 4.1 [Rain]

### 4.2 [Snow]

### 4.3 [Heat]

### 4.4 [Mud]
can go through mud

### 4.5 [Hills]

## 5 [Enhanced Driver Situational Awareness] (Container)

### 5.1 [Sensors] (Container)

#### 5.1.1 [Wheel Rotation Speed]

#### 5.1.2 [Lane Position Localization]
Being able to stay in your own lane

#### 5.1.3 [Wattage]

#### 5.1.4 [Temperature]

#### 5.1.5 [Battery / Voltage level]

#### 5.1.6 [Accel/ decel]

#### 5.1.7 [Speed]

#### 5.1.8 [Sensor Operation Validation]
The Idea here is to indicate whether or not a sensor is working "in condition" or in other words, providing accurate measurements. (TLDR: Working or faulty)

### 5.2 [Ergonomic Indicators]
The ability to see the system diagnostics at a glance